# Grasshopper definition TriangularMeshContours.gh (Grasshopper 1.0.5)
# plug-ins: MeshEdit Components, Human

mesh = Mesh(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)
demesh = DeconstructMesh(Mesh=mesh)  # -> Vertices, Faces, Colours, Normals
explode = MeshExplode(Mesh=mesh, Interpolate=False)
pdecon = Deconstruct(Point=demesh.Vertices)  # -> XComponent, YComponent, ZComponent
# Mesh Contours Algorithm Steps: Given a Triangular mesh and a list of desired contour levels:
# 1. For each provided level in the list do:
# 2. For each provided mesh face do:
# 3.1 If all points in face are above or below level: discard face
# 3.1. If face has some points above and other below do:
# 4. Calculate the points in the mesh face that are at the desired level and draw a line between them.
# 5. Add line to output list
preview = CustomPreview(Geometry=mesh, Material=ColourSwatch(SwatchColor=RGB(66, 155, 194)))
contour_step_m = Panel("0.20")
bnd = Bounds(Numbers=pdecon.ZComponent)
num = Number(bnd)
division = Division(A=num, B=contour_step_m)
range = Range(Domain=bnd, Steps=division)

# ---- group: Mesh Contours
c_script = CSharpScript(meshFaces=explode, contourLevels=range)  # -> out, A; inputs meshFaces: list of Mesh, contourLevels: list of Double
# ---------- c_script: C# ----------
    List<Mesh> remainingFaces = meshFaces;
    List<Line> resultingLines = new List<Line>();
    
    foreach (double level in contourLevels)
    {
      foreach (Mesh face in meshFaces) {
        List<Point3d> overPoints = new List<Point3d>();
        List<Point3d> underPoints = new List<Point3d>();
        
        foreach (Point3d vertex in face.Vertices)
        {
          if (vertex.Z < level) underPoints.Add(vertex);
          else overPoints.Add(vertex);
        }
        if (overPoints.Count == 3 || underPoints.Count == 3) {
          //Print("Triangle is not on level");
        }
        else {
          Print("Triangle is on level {0}", level);
          Line ln = findLevelLine(overPoints, underPoints, level);
          resultingLines.Add(ln);
        }
      }
    }
    A = resultingLines;
# ---------- c_script: C# additional code ----------
  private Line findLevelLine(List<Point3d> overPts, List<Point3d> underPts, double level)
  {
    List<Point3d> linePoints = new List<Point3d>();
       
    foreach (Point3d ovPt in overPts) {
      foreach (Point3d undPt in underPts) {
        double alfa = (level - undPt.Z) / (ovPt.Z - undPt.Z);
        linePoints.Add(new Point3d(undPt.X +(ovPt.X - undPt.X)* alfa, undPt.Y +(ovPt.Y - undPt.Y)* alfa, undPt.Z + (ovPt.Z - undPt.Z) * alfa));
      }
    }
    return new Line(linePoints[0], linePoints[1]);
  }
# ---------- end c_script ----------

# ----
join = JoinCurves(Curves=c_script.A, Preserve=False)
previewlw = CustomPreviewLineweights(Geometry=join, Shader=ColourSwatch(SwatchColor=RGB(255, 255, 255)), Thickness=Slider(3, range=0..10), Absolute=False)
panel = Panel(c_script.out)
